# Grasshopper definition Fanuc_WSG50_example.ghx (Grasshopper 1.0.8)
# plug-ins: Robots

list = RobotsLibrary(
    {"Fanuc-CRX-3iA", "Fanuc-CRX-5iA", "Fanuc-CRX-10iA", "Fanuc-CRX-10iA/L", "Fanuc-CRX-10iA/L Paint", "Fanuc-CRX-20iA/L", "Fanuc-CRX-30iA"}, selected="Fanuc-CRX-10iA/L",
    Type=0)
list_2 = RobotsLibrary({"WSG50"}, selected="WSG50", Type=1)
loadtool = LoadTool(Name=list_2)
loadrobotsystem = LoadRobotSystem(Name=list, Base=PlaneXY(0, 0, 0))

# ----
# Setup - Home
panel = Panel("0")
repeat = RepeatData(Data=panel, Length="6")
degreestoradians = DegreesToRadians(Degrees=repeat, RobotSystem=loadrobotsystem, MechanicalGroup=0)
createtarget = CreateTarget(Joints=degreestoradians, Tool=loadtool, IsCartesian=False)

Z = UnitZ(Factor="14")
Z_2 = UnitZ(Factor=1)

# ----
# Pick and place
number_slider = Slider(-228.8, range=-1000..1000)
xy = XYPlane(Origin=Point(0, 0, 0))
list_3 = FlagFields({"Shoulder": 1, "Elbow": 2, "Wrist": 4}, selected=[])
pt = ConstructPoint(XCoordinate=Slider(321.4, range=-1000..1000), YCoordinate=Slider(-300, range=-1000..1000), ZCoordinate=number_slider)
pt_2 = ConstructPoint(XCoordinate=Slider(-1000, range=-1000..1000), YCoordinate=Slider(-169.2, range=-1000..1000), ZCoordinate=number_slider)
createtarget_2 = CreateTarget(Plane=xy, Configuration=list_3, Tool=loadtool, IsCartesian=True)
Z_3 = UnitZ(Factor="-1")
pl = PlaneNormal(Origin=pt, ZAxis=Z_3)
pl_2 = PlaneNormal(Origin=pt_2, ZAxis=Z_3)
rotate = Rotate(Geometry=pl, Angle=degrees("180"), Plane=pl)  # -> Geometry, Transform

subtraction = Subtraction(A=pt_2, B=Z)
pl_3 = PlaneNormal(Origin=subtraction, ZAxis=Z_2)
rectangle = Rectangle(Plane=pl_3, XSize="-200 to 200", YSize="-14 to 14", Radius=0)  # -> Rectangle, Length
boxrec = BoxRectangle(Rectangle=rectangle.Rectangle, Height="28")
mesh = Mesh(boxrec)

pickandplace = PickAndPlace(
    Pick=pl_2,
    Place=rotate.Geometry,
    Target=createtarget_2,
    Grip="41",
    Approach=100,
    Retreat=100,
    Part=mesh,
    Wait=Slider(2.49, range=0..5))

merge = Merge(Data1=createtarget, Data2=pickandplace, Data3=createtarget)
createprogram = CreateProgram(Name="DefaultProgram", RobotSystem=loadrobotsystem, Targets=merge, StepSize=1)  # -> Program, Code, Duration, Warnings, Errors
programsimulation = ProgramSimulation(Program=createprogram.Program, Time=Slider(0, range=0..1), Normalized=True)  # -> SystemMeshes, JointRotations, Plane, Index, Time, Program, Errors, Parts
mesh_2 = Mesh(programsimulation.SystemMeshes)
mesh_3 = Mesh(programsimulation.Parts)
preview = CustomPreview(Geometry=mesh_3, Material=ColourSwatch(SwatchColor=RGB(255, 128, 82)))
