# Grasshopper definition Fanuc_WSG50_example_multipick.ghx (Grasshopper 1.0.8)
# plug-ins: Robots

list = RobotsLibrary(
    {"Fanuc-CRX-3iA", "Fanuc-CRX-5iA", "Fanuc-CRX-10iA", "Fanuc-CRX-10iA/L", "Fanuc-CRX-10iA/L Paint", "Fanuc-CRX-20iA/L", "Fanuc-CRX-30iA"}, selected="Fanuc-CRX-10iA/L",
    Type=0)
panel = Panel("""-1
-1
-1
-1
-1
-1""")
list_2 = RobotsLibrary({"WSG50"}, selected="WSG50", Type=1)
loadtool = LoadTool(Name=list_2)
loadrobotsystem = LoadRobotSystem(Name=list, Base=PlaneXY(0, 0, 0), JointLimits=panel)

# ----
# Setup - Home
panel_2 = Panel("0")
repeat = RepeatData(Data=panel_2, Length="6")
degreestoradians = DegreesToRadians(Degrees=repeat, RobotSystem=loadrobotsystem, MechanicalGroup=0)
createtarget = CreateTarget(Joints=degreestoradians, Tool=loadtool, IsCartesian=False)

# ----
# Pick and place
number_slider = Slider(-228.8, range=-1000..1000)
xy = XYPlane(Origin=Point(0, 0, 0))
list_3 = FlagFields({"Shoulder": 1, "Elbow": 2, "Wrist": 4}, selected=[])
pt = ConstructPoint(XCoordinate=Slider(517.9, range=-1000..1000), YCoordinate=Slider(-300, range=-1000..1000), ZCoordinate=number_slider)
pt_2 = ConstructPoint(XCoordinate=Slider(-708.9, range=-1000..1000), YCoordinate=Slider(-904.1, range=-1000..1000), ZCoordinate=number_slider)
createtarget_2 = CreateTarget(Plane=xy, Configuration=list_3, Tool=loadtool, IsCartesian=True)
Z = UnitZ(Factor="-1")
pl = PlaneNormal(Origin=pt, ZAxis=Z)

# ----
# Spawn (pick)
number_slider_2 = Slider(80, range=0..100)
vec = VectorXYZ(XComponent=0, YComponent=number_slider_2, ZComponent=0)  # -> Vector, Length
repeat_2 = RepeatData(Data=vec.Vector, Length="10")
ma = MassAddition(Input=repeat_2)  # -> Result, PartialResults
addition = Addition(A=pt_2, B=ma.PartialResults)
pl_2 = PlaneNormal(Origin=addition, ZAxis=Z)

# ----
# Place
panel_3 = Panel("28")
repeat_3 = RepeatData(Data=panel_3, Length="9")
merge = Merge(Data1="0", Data2=repeat_3)  # -> flatten(Result)
repeat_4 = RepeatData(Data=pl, Length="10")
ma_2 = MassAddition(Input=merge)  # -> Result, PartialResults
Z_2 = UnitZ(Factor=ma_2.PartialResults)
deplane = DeconstructPlane(Plane=repeat_4)  # -> Origin, XAxis, YAxis, ZAxis
addition_2 = Addition(A=deplane.Origin, B=Z_2)
repeat_5 = RepeatData(Data="90", Length="10")
pl_3 = ConstructPlane(Origin=addition_2, XAxis=deplane.XAxis, YAxis=deplane.YAxis)
ma_3 = MassAddition(Input=repeat_5)  # -> Result, PartialResults
rad = Radians(Degrees=ma_3.PartialResults)
rotate = Rotate(Geometry=pl_3, Angle=rad, Plane=pl_3)  # -> Geometry, Transform

# ----
# Parts
panel_4 = Panel("14")
Z_3 = UnitZ(Factor=panel_4)
Z_4 = UnitZ(Factor=1)
subtraction = Subtraction(A=addition, B=Z_3)
pl_4 = PlaneNormal(Origin=subtraction, ZAxis=Z_4)
rectangle = Rectangle(Plane=pl_4, XSize="-200 to 200", YSize="-14 to 14", Radius=0)  # -> Rectangle, Length
boxrec = BoxRectangle(Rectangle=rectangle.Rectangle, Height="28")
mesh = Mesh(boxrec)

pickandplace = PickAndPlace(
    Pick=pl_2,
    Place=rotate.Geometry,
    Target=createtarget_2,
    Grip="41",
    Approach=100,
    Retreat=100,
    Part=mesh,
    Wait=Slider(2.49, range=0..5))  # -> flatten(Targets)

entwine = Entwine(Branch00=createtarget, Branch01=pickandplace, Branch02=createtarget, FlattenInputs=True)  # -> flatten(Result)
createprogram = CreateProgram(Name="DefaultProgram", RobotSystem=loadrobotsystem, Targets=entwine, StepSize="10")  # -> Program, Code, Duration, Warnings, Errors
programsimulation = ProgramSimulation(Program=createprogram.Program, Time=Slider(0, range=0..1), Normalized=True)  # -> SystemMeshes, JointRotations, Plane, Index, Time, Program, Errors, Parts
simpletrail = SimpleTrail(Program=programsimulation.Program, Length="3000", MechanicalGroup=0)
deg = Degrees(Radians=programsimulation.JointRotations)
mesh_2 = Mesh(programsimulation.SystemMeshes)
mesh_3 = Mesh(programsimulation.Parts)
preview = CustomPreview(Geometry=mesh_3, Material=ColourSwatch(SwatchColor=RGB(255, 128, 82)))
